% Simulink data dictionary BatteryManagement_data.sldd

BESSoCReset = Simulink.Parameter(false, DataType="boolean")  % Boolean to reset ES SoC

BMSCmds_BUS = Simulink.Bus()
  IESMin: double, Unit="A"  % BMS Lower Current Limit (Peak Charge Current)
  IESMax: double, Unit="A"  % BMS Upper Current Limit (Peak Discharge Current)

rCellCapacity = Simulink.Parameter(4.8, DataType="double", Unit="Ah")  % Nominal Cell Capacity
SoC_BP = Simulink.Parameter([1 2 3 4 5 6 7 8 9 10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 100], DataType="single", Unit="%")  % State of Charge Lookup Table Breakpoints
TCell_BP = Simulink.Parameter([-10 0 25 40], Unit="Celsius")  % Cell Temperature Lookup Table Breakpoints

BMSInputs_BUS = Simulink.Bus()
  IESIVT: double, Unit="A"  % ES IVT Current Measurement
  VESCell: double, Unit="V"  % Array of Cell Voltages
  NPTState: double  % Main Powertrain State

R2_LUT = Simulink.Parameter([0.001022342; 0.001022342; 0.001022342; 0.001022342; 0.001022342; 0.001022342; 0.001022342; 0.001022342; 0.001022342; 0.001022342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 0.001174027])  % R2 Lookup Table Data Points
R1_LUT = Simulink.Parameter([0.00104727; 0.00104727; 0.00104727; 0.00104727; 0.00104727; 0.00104727; 0.00104727; 0.00104727; 0.00104727; 0.00104727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 0.0002831548])  % R1 Lookup Table Data Points

R0_LUT = Simulink.Parameter([0.05690268 0.05755069 0.05767309 0.05756274 0.05737873 0.05719311 0.05682 0.05641193 0.05619743 0.05608056 0.05576409 0.05527581 0.05481894 0.05442593 0.05402748 0.05357587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
 0.06291642 0.06271853 0.062749 0.06274179 0.06300545 0.06295343 0.06228194 0.06167138 0.06116047 0.06063949 0.05994003 0.05943308 0.05917356 0.05888439 0.05829443 0.05771693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
 0.1083836 0.1042765 0.09750736 0.09375013 0.08938195 0.08546447 0.08175755 0.07896572 0.07637004 0.07435001 0.07284335 0.07168983 0.07099475 0.07016753 0.06872966 0.06737123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
 0.1085269 0.1176751 0.1232357 0.1269592 0.1300718 0.1176045 0.1098617 0.1026883 0.09519208 0.0894406 0.08472906 0.08086544 0.07810081 0.0758201 0.07407537 0.07304839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 ], Unit="Ω")  % R0 Lookup Table Data Points

OCV_LUT = Simulink.Parameter([3.011622; 3.085757; 3.141775; 3.186318; 3.22335; 3.253901; 3.278789; 3.300704; 3.321185; 3.338732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 4.104072], Unit="V")  % Open-Circuit Voltage Lookup Table Data Points
NCellsSeries = Simulink.Parameter(96)  % Number of Cells in Series
NCellsParallel = Simulink.Parameter(31)  % Number of Cells in Parallel
C2_LUT = Simulink.Parameter([25640.9; 25640.9; 25640.9; 25640.9; 25640.9; 25640.9; 25640.9; 25640.9; 25640.9; 25640.9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 23205.46])  % C2 Lookup Table Data Points
C1_LUT = Simulink.Parameter([1295651; 1295651; 1295651; 1295651; 1295651; 1295651; 1295651; 1295651; 1295651; 1295651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 2605208])  % C1 Lookup Table Data Points
tSimBattMgt = Simulink.Parameter(0.001, DataType="double", Unit="s")  % Simulation Step Time for Battery Management Model
rInitialSoC = Simulink.Parameter(75, DataType="double", Unit="%")  % Initial Cells SoC