% Simulink data dictionary Contactors_data.sldd

ContactorsInputs_BUS = Simulink.Bus()
  VESIVT: double, Unit="V"  % ES IVT Voltage Measurement
  VCUKIVT: double, Unit="V"  % CUK IVT Voltage Measurement
  NPTState: double  % Main Powertrain State

tCloseContDelay = Simulink.Parameter(0.2, Unit="s")  % Delay For Duration of Contactors Closing

eNPTState = enum(DefaultValue="Off", StorageType="uint8")  % Enumeration of Powertrain States
  Off = 0  % Powertrain is off
  ContactorsCloseRequest = 1  % Contactors are requested to close
  ContactorsClosed = 2  % Contactors are closed
  TorqueControl = 3  % Motor accepts torque requests
  ContactorsOpenRequest = 4  % Contactors are requested to open

BServiceDisconnectPos = Simulink.Parameter(true, DataType="boolean")  % Positive Service Disconnect Switch (Connected/Disconnected)
BServiceDisconnectNeg = Simulink.Parameter(true, DataType="boolean")  % Negative Service Disconnect Switch (Connected/Disconnected)

ContactorsCmds_BUS = Simulink.Bus()
  BContPosRequested: boolean  % Request to Close Positive Contactors
  BContNegRequested: boolean  % Request to Close Negative Contactors
  BPrechargeRequested: boolean  % Request to Close Precharge Switch
  BActiveDischargeRequested: boolean  % Request to Close Active Discharge Switch

tSimCont = Simulink.Parameter(0.001, DataType="double", Unit="s")  % Simulation Step Time for Contactors Model