% Simulink data dictionary ElectricPowertrain_data.sldd

ControllerCmds_BUS = Simulink.Bus()
  ContactorsCmds: Bus: ContactorsCmds_BUS

PhysicalInputs_BUS = Simulink.Bus()
  BServiceDisconnectPos: boolean
  BServiceDisconnectNeg: boolean

ContactorsCmds_BUS = Simulink.Bus()
  BContPosRequested: boolean
  BContNegRequested: boolean
  BPrechargeRequested: boolean
  BActiveDischargeRequested: boolean

BServiceDisconnectPos = Simulink.Parameter(true, DataType="boolean")
tCloseContDelay = Simulink.Parameter(0.2)
BServiceDisconnectNeg = Simulink.Parameter(true, DataType="boolean")

DriverCmds_BUS = Simulink.Bus()
  BStartSwitch: boolean
  BDrive: boolean
  IESDCLink: double

rCellCapacity = Simulink.Parameter(repmat(64, 1, 6), DataType="double")
ITest = [10 9 8 7 6 5 4 3 2 1]
INissanLeaf = [0.04 0.04 0.04 0.04 0.04 0.04 0.04 0.04 0.04 0.04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 0.04]

PlantOutput_BUS = Simulink.Bus()
  VCUKIVT: double
  IESIVT: double
  VESDCLink: double
  VESIVT: double
  BContactorsClosed: boolean
  VESCell: double[6]
  ICUKIVT: double

tSim = Simulink.Parameter(0.005)
IConstantStep = Simulink.Parameter(50)
tConstantStep = Simulink.Parameter(10)
rInitialSoC = Simulink.Parameter(repmat(90, 1, 6), DataType="double")
NProfile = Simulink.Parameter(0)
BPlantSoCReset = Simulink.Parameter(false, DataType="boolean")

eNPTState = enum(DefaultValue="Off", StorageType="uint8")
  Off = 0  % Powertrain is off
  ContactorsCloseRequest = 1  % Contactors are requested to close
  ContactorsClosed = 2  % Contactors are closed
  TorqueControl = 3  % Motor accepts torque requests
  ContactorsOpenRequest = 4  % Contactors are requested to open

BDrive = Simulink.Parameter(false, DataType="boolean")
BStartSwitch = Simulink.Parameter(false, DataType="boolean")