% Simulink data dictionary MotorControl_data.sldd

Tf = Simulink.Parameter(0, DataType="single", Unit="Nm")  % Static Friction
NPoles = Simulink.Parameter(6, DataType="single")  % Number of Poles
Rs = Simulink.Parameter(0.00423, DataType="double", Unit="Ω")  % Stator Resistance Per Phase
Ke = Simulink.Parameter(59.16664, DataType="double", Unit="Vpk_LL/krpm")  % Back-emf Constant
Ld = Simulink.Parameter(0.000171, DataType="double", Unit="H")  % Stator d-axis Inductance
Lq = Simulink.Parameter(0.000391, DataType="double", Unit="H")  % Stator q-axis Inductance
J = Simulink.Parameter(0.0036, DataType="double", Unit="kgm^2")  % Physical Inertia
F = Simulink.Parameter(0.0011, DataType="double", Unit="Nm/rad/s")  % Viscous Damping
w_eff_bp = Simulink.Parameter([-1000 -500 0 500 1000], DataType="single")  % Vector of Speeds for Tabulated Losses
T_eff_bp = Simulink.Parameter([-200 -100 0 100 200], DataType="single")  % Vector of Torques for Tabulated Losses

ploss_table = Simulink.Parameter([1 0.999 0.989 0.997 0.996
 0.995 0.994 0.993 0.992 0.991
 0.99 0.989 0.988 0.987 0.986
 0.985 0.984 0.983 0.982 0.981
 0.98 0.979 0.978 0.977 0.976], DataType="double")  % Power Loss Table

FOCInputs_BUS = Simulink.Bus()
  TMotorTorque: double, Unit="Nm"  % Motor Output Torque
  wRotorSpd: double, Unit="rad/s"  % Rotor Speed
  IPhase: double[3], Unit="A"  % Phase Currents
  aRotorMechPos: double, Unit="rad"  % Rotor Mechanical Angle

FOCCmds_BUS = Simulink.Bus()
  VPhase: double[1 3], Unit="V"  % Phase Voltages

tSimMoCo = Simulink.Parameter(1.0e-5, DataType="double", Unit="s")  % Simulation Step Time for Motor Control model
PMFluxLinkage = Simulink.Parameter(0.1039, DataType="double", Unit="Wb")  % Permanent Magnet Flux Linkage